# Grasshopper definition rhino_input.gh (Grasshopper 1.0.7)
# plug-ins: Kangaroo2 Components

encodedfile = GetString(AtLeast=1, AtMost=1, TreeAccess=False)
wrong_input_1 = FilePath("C:\Users\david\IAAC\MaCAD\datamgmt\repos\bimsc24-datamgmt-session06\src\assets\wrong_input.3dm")

# ---- group: right input
path = FilePath("C:\Users\david\IAAC\MaCAD\datamgmt\repos\bimsc24-datamgmt-session06\src\assets\rhino_input.3dm")

# ----
nodesize = Slider(0.5, range=0..1)
strutsize = Slider(0.68, range=0..1)
python = GhPythonScript(data=encodedfile, FP=path)  # -> out, geom, layerIndex, layers, layerColor
# ---------- python: Python ----------
import System
import Rhino

#load Rhino file from string, or from local path
try:
    b64 = System.Convert.FromBase64String(data)
    _dmfile = Rhino.FileIO.File3dm.FromByteArray(b64)
except:
    _dmfile = Rhino.FileIO.File3dm.Read(FP)
    print _dmfile



objtable = _dmfile.Objects
geom = []
geomLayerIndexList = []

#get objects from document
for obj in objtable:
    
    if not isinstance(obj.Geometry,Rhino.Geometry.InstanceReferenceGeometry):
        #get user strings from document and assign to geometry
        for k in obj.Attributes.GetUserStrings().AllKeys:
            value =  obj.Attributes.GetUserString(k)
            obj.Geometry.SetUserString(k, value)
       
        geom.append(obj.Geometry)
        geomLayerIndexList.append(obj.Attributes.LayerIndex)
        

geom_= geom
layerIndex_ = geomLayerIndexList

#get layer information
layers = []
layerColor = []
for l in _dmfile.Layers:
    layerColor.append(l.Color)
    layers.append(l)
    
    
layers_ = layers
layerColor_  = layerColor
# ---------- end python ----------
strutsize_2 = GetNumber(strutsize, AtLeast=1, AtMost=1, Maximum=1.797693135e+308, Minimum=-1.797693135e+308, TreeAccess=False)
nodesize_2 = GetNumber(nodesize, AtLeast=1, AtMost=1, Maximum=1.797693135e+308, Minimum=-1.797693135e+308, TreeAccess=False)
medges = MeshEdges(Mesh=python.geom)  # -> NakedEdges, InteriorEdges, NonManifoldEdges
mesh = Mesh(python.geom)
merge = Merge(Data1=medges.NakedEdges, Data2=medges.InteriorEdges, Data3=medges.NonManifoldEdges)
null = NullItem(Item=mesh)  # -> NullFlags, InvalidFlags, Description
ma = MassAddition(Input=null.NullFlags)  # -> Result, PartialResults
mp = MultiPipe(Curves=merge, NodeSize=nodesize_2, EndOffset=1, StrutSize=strutsize_2, Segment=0, KinkAngle=0.6, CubeFit=0, Caps=0)
larger = LargerThan(FirstNumber=ma.Result, SecondNumber=0)  # -> LargerThan, OrEqualTo
filter = StreamFilter(Gate=larger.LargerThan, Stream0="All good!", Stream1="Wrong input geometry!")
context_bake = ContextBake(Geometry=mp)
context_print = ContextPrint(Errors=filter)
